# Grasshopper definition get_rec_bounds_coordinates.gh (Grasshopper 1.0.8)
# plug-ins: Pufferfish

# ---- group: The picture
srf = Surface(<surface referenced from the Rhino model>)

# ---- group: All the curves in the drawing
crv = Curve([<curve referenced from the Rhino model> x17])

# ----
brec = BoundingRectangle(Geometry=srf, Plane=PlaneXY(0, 0, 0), Axis=0, Slide=0, Union=True)  # -> Bounding, DimensionX, DimensionY
brec_2 = BoundingRectangle(Geometry=graft(crv), Plane=PlaneXY(0, 0, 0), Axis=0, Slide=0, Union=True)  # -> Bounding, DimensionX, DimensionY
bnd = Bounds(Numbers=[brec.DimensionX, brec.DimensionY])
dom = ConstructDomain(DomainStart=Slider(2550, range=0..10000), DomainEnd=Slider(3300, range=0..10000))
explode = Explode(Curve=brec_2.Bounding, Recursive=True)  # -> Segments, Vertices

# ---- group: Top left
item = ListItem(List=explode.Vertices, Index=Slider(3, range=0..100), Wrap=True)
pdecon = Deconstruct(Point=item)  # -> XComponent, YComponent, ZComponent
remap = RemapNumbers(Value=[pdecon.XComponent, pdecon.YComponent, pdecon.ZComponent], Source=bnd, Target=dom)  # -> simplify(Mapped), Clipped

# ---- group: Bottom right
item_2 = ListItem(List=explode.Vertices, Index=Slider(1, range=0..100), Wrap=True)
pdecon_2 = Deconstruct(Point=item_2)  # -> XComponent, YComponent, ZComponent
remap_2 = RemapNumbers(Value=[pdecon_2.XComponent, pdecon_2.YComponent, pdecon_2.ZComponent], Source=bnd, Target=dom)  # -> simplify(Mapped), Clipped

# ----
panel = Panel(remap.Mapped)
panel_2 = Panel(remap_2.Mapped)
id = Guid(crv)
int = Integer(panel_2)
int_2 = Integer(panel)
panel_3 = Panel(int)
# Subtract from the total height of the image (3330) to get the  y coordinate. Z coordinate can be ignored
panel_4 = Panel(int_2)
